# Dynamo graph Home.dyn (Dynamo 2.1.0.7500)

file_path = Filename(".\boundaries.xlsx")  # graph input
code_block = CodeBlock { "boundaries"; }
code_block_2 = CodeBlock { 0; }
code_block_3 = CodeBlock { ["room name","room area","room boundary"]; }

# group: rooms
categories = Categories("OST_Rooms")  # graph input
all_elements_of_category = ElementsOfCategory(Category=categories)

# group: remove duplicate rooms
code_block_4 = CodeBlock { "Area"; }
getParameterValueByName = Element.GetParameterValueByName(element=all_elements_of_category, parameterName=code_block_4)
code_block_5 = CodeBlock { ""; }
eq = getParameterValueByName == code_block_5
filterByBoolMask = List.FilterByBoolMask(list=all_elements_of_category, mask=eq)
delete = Orchid.RevitProject.Elements.Element.Delete(element=filterByBoolMask.in)

name = Room.Name(room=filterByBoolMask.out)
code_block_6 = CodeBlock { "Number"; }
getParameterValueByName_2 = Element.GetParameterValueByName(element=filterByBoolMask.out, parameterName=code_block_6)
code_block_7 = CodeBlock(name=name, number=getParameterValueByName_2) { name+" "+number; }
centerBoundary = Room.CenterBoundary(room=filterByBoolMask.out)
byJoinedCurves = PolyCurve.ByJoinedCurves(curves=centerBoundary)
length = Curve.Length()  # unwired: curve
sortByFunction = List.SortByFunction(list=byJoinedCurves@L2, func=length)
lastItem = List.LastItem(list=sortByFunction@L2)
code_block_8 = CodeBlock { null; }
ne = lastItem != code_block_8
filterByBoolMask_2 = List.FilterByBoolMask(list=code_block_7, mask=ne)
area = Room.Area(room=filterByBoolMask.out)
filterByBoolMask_3 = List.FilterByBoolMask(list=area, mask=ne)
filterByBoolMask_4 = List.FilterByBoolMask(list=lastItem, mask=ne)
curves = PolyCurve.Curves(polyCurve=filterByBoolMask_4.in)
list_create = List.Create(item0=filterByBoolMask_2.in, item1=filterByBoolMask_3.in, item2=curves)
addItemToFront = List.AddItemToFront(item=code_block_3@L1, list=list_create@L3)
transpose = List.Transpose(lists=addItemToFront)
flatten = List.Flatten(list=transpose@L3)
code_block_9 = CodeBlock { true; }
exportExcel = Data.ExportExcel(filePath=file_path, sheetName=code_block, startRow=code_block_2, startCol=code_block_2, data=flatten, overWrite=code_block_9)
